# Dynamo graph Расчёт_краски_Ревит.dyn (Dynamo 2.0.2.6826)

# group: Входные данные для труб по ГОСТ 3262-75
поставьте_true_если_хотите = BoolSelector(false)  # "Поставьте True, если хотите учесть трубы по ГОСТ 3262-75 в расчёте!"; graph input
напишите_диаметры_труб_через = StringInput("")  # "Напишите диаметры труб через пробел. Пример: 6 8 10"; graph input
напишите_количество_метров_для = StringInput("")  # "Напишите количество метров для каждой трубы, соответственно диаметрам труб через пробел. Пример: 10 20 30"; graph input

# group: Входные данные для швеллеров по ГОСТ 8240-97
поставьте_true_если_хотите_2 = BoolSelector(false)  # "Поставьте True, если хотите учесть швеллеры по ГОСТ 8240-97 в расчёте!"; graph input
напишите_номера_швеллеров_через = StringInput("")  # "Напишите номера швеллеров через пробел. Пример: 5 8 10"; graph input
напишите_количество_килограмм = StringInput("")  # "Напишите количество килограмм для каждого типа швеллера, соответственно номерам швеллеров через пробел. Пример: 10 20 30"; graph input

# group: Входные данные для уголков по ГОСТ 8509-93
поставьте_true_если_хотите_3 = BoolSelector(false)  # "Поставьте True, если хотите учесть уголки по ГОСТ 8509-93 в расчёте!"; graph input
напишите_данные_для_каждого = StringInput("")  # "Напишите данные для каждого уголка в формате "номер уголка-толщина уголка" через пробел. Пример: 2-3 3-3 5-4"; graph input
напишите_количество_килограмм_2 = StringInput("")  # "Напишите количество килограмм для каждого типа уголка, соответственно номерам уголков и их толщинам через пробел. Пример: 10 20 30"; graph input

# group: Входные данные для полосы по ГОСТ 103-2006
поставьте_true_если_хотите_4 = BoolSelector(false)  # "Поставьте True, если хотите учесть полосы по ГОСТ 103-2006 в расчёте!"; graph input
напишите_данные_для_каждой = StringInput("")  # "Напишите данные для каждой полосы в формате "ширина полосы-толщина полосы" через пробел. Пример: 10-4 20-5 70-4"; graph input
напишите_количество_метров_для_2 = StringInput("")  # "Напишите количество метров для каждого типа полосы, соответственно ширине и толщине полосы через пробел. Пример: 10 20 30"; graph input

# group: Анализаторы входных данных
модуль_проверки_вводимых_данных = Python(IN[0]=поставьте_true_если_хотите, IN[1]=напишите_диаметры_труб_через, IN[2]=напишите_количество_метров_для)
# ---------- модуль_проверки_вводимых_данных.python (54 lines) ----------
def examination_dimension(temp_value):
	if temp_value not in [6, 8, 10, 15, 20, 25, 32, 40, 50, 65, 80, 90, 100, 125, 150]:
		return 'Код 012'
	elif temp_value in dimension_list:
		return 'Код 011'
	else:
		dimension_list.append(temp_value)
		return 'Код 200'


if IN[0]:
	code_digit, total_flag = '', True
	first_temp, second_temp = IN[1].strip(), IN[2].strip()
	if len(first_temp) == 0 or len(second_temp) == 0:
		code_digit = "Код 013"
		total_flag = False
	dimension_list, value_list = [], []
	temp_char  = ''
	for now in first_temp:
		if not total_flag:
			break
		if now.isdigit():
			temp_char += now
		elif temp_char:
			code_digit = examination_dimension(int(temp_char))
			if code_digit != 'Код 200':
				total_flag = False
			temp_char = ''
	if temp_char:
		code_digit = examination_dimension(int(temp_char))
		if code_digit != 'Код 200':
				total_flag = False
	temp_char = ''
	second_list_length = len(second_temp)
	for i in range(second_list_length):
		if not total_flag:
			break
		if second_temp[i].isdigit():
			temp_char += second_temp[i]
		elif i != 0 and i != second_list_length - 1 and (second_temp[i] == ',' or second_temp[i] == '.'):
			temp_char += '.'
		elif temp_char:
			value_list.append(float(temp_char))
			temp_char = ''
	if temp_char:
		value_list.append(float(temp_char))
	if len(dimension_list) != len(value_list) and code_digit not in ['Код 011', 'Код 012', 'Код 013']:
		OUT = 'Код 014'
	elif code_digit != 'Код 200':
		OUT = code_digit
	else:
		OUT = dimension_list, value_list
else:
	OUT = "Код 01404"
# ----------------------------------------
модуль_проверки_вводимых_данных_2 = Python(IN[0]=поставьте_true_если_хотите_2, IN[1]=напишите_номера_швеллеров_через, IN[2]=напишите_количество_килограмм)
# ---------- модуль_проверки_вводимых_данных_2.python (56 lines) ----------
def examination_dimension(temp_value):
	if temp_value not in ['5', '6.5', '8', '10', '12', '14', '16', '16a', '16а', '18', '18a', '18а', '20', '22', '24', '27', '30', '33', '36', '40']:
		return 'Код 022'
	elif temp_value in dimension_list:
		return 'Код 021'
	else:
		dimension_list.append(temp_value)
		return 'Код 200'


if IN[0]:
	code_digit, total_flag = '', True
	first_temp, second_temp = IN[1].strip(), IN[2].strip()
	if len(first_temp) == 0 or len(second_temp) == 0:
		code_digit = "Код 023"
		total_flag = False
	dimension_list, value_list = [], []
	temp_char  = ''
	for now in first_temp:
		if not total_flag:
			break
		if now == 'a' or now == 'а':
			temp_char += now
		elif now.isdigit():
			temp_char += now
		elif temp_char:
			code_digit = examination_dimension(temp_char)
			if code_digit != 'Код 200':
				total_flag = False
			temp_char = ''
	if temp_char:
		code_digit = examination_dimension(temp_char)
		if code_digit != 'Код 200':
				total_flag = False
	temp_char = ''
	second_list_length = len(second_temp)
	for i in range(second_list_length):
		if not total_flag:
			break
		if second_temp[i].isdigit():
			temp_char += second_temp[i]
		elif i != 0 and i != second_list_length - 1 and (second_temp[i] == ',' or second_temp[i] == '.'):
			temp_char += '.'
		elif temp_char:
			value_list.append(float(temp_char))
			temp_char = ''
	if temp_char:
		value_list.append(float(temp_char))
	if len(dimension_list) != len(value_list) and code_digit not in ['Код 021', 'Код 022', 'Код 023']:
		OUT = 'Код 024'
	elif code_digit != 'Код 200':
		OUT = code_digit
	else:
		OUT = dimension_list, value_list
else:
	OUT = "Код 02404"
# ----------------------------------------
модуль_проверки_вводимых_данных_3 = Python(IN[0]=поставьте_true_если_хотите_3, IN[1]=напишите_данные_для_каждого, IN[2]=напишите_количество_килограмм_2)
# ---------- модуль_проверки_вводимых_данных_3.python (63 lines) ----------
def examination_dimension(temp_value):
	try:
		ftv, stv = map(float, temp_value.split('-'))
	except ValueError:
		return 'Код 035'
	my_examination_dict = {2.0: (3.0, 4.0), 2.5: (3.0, 4.0), 2.8: (3.0), 3.0: (3.0, 4.0), 3.2: (3.0, 4.0), 3.5: (3.0, 4.0, 5.0), 4.0: (3.0, 4.0, 5.0), 4.5: (3.0, 4.0, 5.0), 5.0: (3.0, 4.0, 5.0, 6.0), 5.6: (4.0, 5.0), 6.3: (4.0, 5.0, 6.0), 7.0: (4.5, 5.0, 6.0, 7.0, 8.0), 7.5: (5.0, 6.0, 7.0, 8.0, 9.0), 8.0: (5.5, 6.0, 7.0, 8.0), 9.0: (6.0, 7.0, 8.0, 9.0), 10.0: (6.5, 7.0, 8.0, 10.0, 12.0, 14.0, 16.0), 11.0: (7.0, 8.0), 12.5: (8.0, 9.0, 10.0, 12.0, 14.0, 16.0), 14.0: (9.0, 10.0, 12.0), 16.0: (10.0, 11.0, 12.0, 14.0, 16.0, 18.0, 20.0), 18.0: (11.0, 12.0), 20.0: (12.0, 13.0, 14.0, 16.0, 20.0, 25.0, 30.0), 22.0: (14.0, 16.0), 25.0: (16.0, 18.0, 20.0, 22.0, 25.0, 28.0, 30.0, 35.0)}
	if ftv not in my_examination_dict or stv not in my_examination_dict[ftv]:
		return 'Код 032'
	elif temp_value in dimension_list:
		return 'Код 031'
	else:
		dimension_list.append(temp_value)
		return 'Код 200'


if IN[0]:
	code_digit, total_flag = '', True
	first_temp, second_temp = IN[1].strip(), IN[2].strip()
	if len(first_temp) == 0 or len(second_temp) == 0:
		code_digit = "Код 033"
		total_flag = False
	dimension_list, value_list = [], []
	temp_char  = ''
	for now in first_temp:
		if not total_flag:
			break
		if now == '-':
			temp_char += now
		elif now == '.' or now == ',':
			temp_char += '.'
		elif now.isdigit():
			temp_char += now
		elif temp_char:
			code_digit = examination_dimension(temp_char)
			if code_digit != 'Код 200':
				total_flag = False
			temp_char = ''
	if temp_char:
		code_digit = examination_dimension(temp_char)
		if code_digit != 'Код 200':
				total_flag = False
	temp_char = ''
	second_list_length = len(second_temp)
	for i in range(second_list_length):
		if not total_flag:
			break
		if second_temp[i].isdigit():
			temp_char += second_temp[i]
		elif i != 0 and i != second_list_length - 1 and (second_temp[i] == ',' or second_temp[i] == '.'):
			temp_char += '.'
		elif temp_char:
			value_list.append(float(temp_char))
			temp_char = ''
	if temp_char:
		value_list.append(float(temp_char))
	if len(dimension_list) != len(value_list) and code_digit not in ['Код 031', 'Код 032', 'Код 033', 'Код 035']:
		OUT = 'Код 034'
	elif code_digit != 'Код 200':
		OUT = code_digit
	else:
		OUT = dimension_list, value_list
else:
	OUT = "Код 03404"
# ----------------------------------------
модуль_проверки_вводимых_данных_4 = Python(IN[0]=поставьте_true_если_хотите_4, IN[1]=напишите_данные_для_каждой, IN[2]=напишите_количество_метров_для_2)
# ---------- модуль_проверки_вводимых_данных_4.python (62 lines) ----------
def examination_dimension(temp_value):
	try:
		ftv, stv = map(int, temp_value.split('-'))
	except ValueError:
		return 'Код 045'
	ftv_list = [10, 12, 14, 15, 16, 18, 20, 22, 25, 28, 30, 32, 35, 36, 40, 45, 50, 55, 60, 63, 65, 70, 75, 80, 85, 90, 95, 100, 105, 110, 120, 125, 130, 140, 150, 160, 170, 180, 190, 200]
	stv_list = [4, 5, 6, 7, 8, 9, 10, 11, 12, 14, 15, 16, 18, 20, 22, 25, 28, 30, 32, 35, 36, 40, 45, 50, 56, 60, 80]
	if ftv not in ftv_list or stv not in stv_list:
		return 'Код 042'
	elif temp_value in dimension_list:
		return 'Код 041'
	else:
		dimension_list.append(temp_value)
		return 'Код 200'


if IN[0]:
	code_digit, total_flag = '', True
	first_temp, second_temp = IN[1].strip(), IN[2].strip()
	if len(first_temp) == 0 or len(second_temp) == 0:
		code_digit = "Код 043"
		total_flag = False
	dimension_list, value_list = [], []
	temp_char  = ''
	for now in first_temp:
		if not total_flag:
			break
		if now == '-':
			temp_char += now
		elif now.isdigit():
			temp_char += now
		elif temp_char:
			code_digit = examination_dimension(temp_char)
			if code_digit != 'Код 200':
				total_flag = False
			temp_char = ''
	if temp_char:
		code_digit = examination_dimension(temp_char)
		if code_digit != 'Код 200':
				total_flag = False
	temp_char = ''
	second_list_length = len(second_temp)
	for i in range(second_list_length):
		if not total_flag:
			break
		if second_temp[i].isdigit():
			temp_char += second_temp[i]
		elif i != 0 and i != second_list_length - 1 and (second_temp[i] == ',' or second_temp[i] == '.'):
			temp_char += '.'
		elif temp_char:
			value_list.append(float(temp_char))
			temp_char = ''
	if temp_char:
		value_list.append(float(temp_char))
	if len(dimension_list) != len(value_list) and code_digit not in ['Код 041', 'Код 042', 'Код 043', 'Код 045']:
		OUT = 'Код 044'
	elif code_digit != 'Код 200':
		OUT = code_digit
	else:
		OUT = dimension_list, value_list
else:
	OUT = "Код 04404"
# ----------------------------------------

# group: Расчётные блоки данных
расчётный_блок = Python(IN[0]=модуль_проверки_вводимых_данных)
# ---------- расчётный_блок.python (11 lines) ----------
from math import pi

dimension_diameter_dict = {6: 10.2, 8: 13.5, 10: 17.0, 15: 21.3, 20: 26.8, 25: 33.5, 32: 42.3, 40: 48.0, 50: 60.0, 65: 75.5, 80: 88.5, 90: 101.3, 100: 114.0, 125: 140.0, 150: 165.0}
if IN[0][:3] == 'Код':
	OUT = IN[0]
else:
	dimension_list, count_list = IN[0][:len(IN[0]) // 2][0], IN[0][len(IN[0]) // 2 : len(IN[0])][0]
	total = 0.0
	for i in range(len(dimension_list)):
		total += dimension_diameter_dict[dimension_list[i]] * count_list[i] / 1000.0 * pi
	OUT = total
# ----------------------------------------
расчётный_блок_2 = Python(IN[0]=модуль_проверки_вводимых_данных_2)
# ---------- расчётный_блок_2.python (10 lines) ----------
dimension_channel_dict = {'5': (50, 32, 4.4, 7.0, 4.84), '6.5': (65, 36, 4.4, 7.2, 5.9), '8': (80, 40, 4.5, 7.4, 7.05), '10': (100, 46, 4.5, 7.6, 8.59), '12': (120, 52, 4.8, 7.8, 10.4), '14': (140, 58, 4.9, 8.1, 12.3), '16': (160, 64, 5.0, 8.4, 14.2), '16a': (160, 68, 5.0, 9.0, 15.3), '16а': (160, 68, 5.0, 9.0, 15.3), '18': (180, 70, 5.1, 8.7, 16.3), '18a': (180, 74, 5.1, 9.3, 17.4), '18а': (180, 74, 5.1, 9.3, 17.4), '20': (200, 76, 5.2, 9.0, 18.4), '22': (220, 82, 5.4, 9.5, 21.0), '24': (240, 90, 5.6, 10.0, 24.0), '27': (270, 95, 6.0, 10.5, 27.7), '30': (300, 100, 6.5, 11.0, 31.8), '33': (330, 105, 7.0, 11.7, 36.5), '36': (360, 110, 7.5, 12.6, 41.9), '40': (400, 115, 8.0, 13.5, 48.3)}
if IN[0][:3] == 'Код':
	OUT = IN[0]
else:
	dimension_list, count_list = IN[0][:len(IN[0]) // 2][0], IN[0][len(IN[0]) // 2 : len(IN[0])][0]
	total = 0.0
	for i in range(len(dimension_list)):
		h, b, s, t, weight = dimension_channel_dict[dimension_list[i]]
		total += ((h + 2 * b - s) / 500.0 + 2 * (h * s + 2 * (b - s) * t) / 10.0**6) * count_list[i] / weight
	OUT = total
# ----------------------------------------
расчётный_блок_3 = Python(IN[0]=модуль_проверки_вводимых_данных_3)
# ---------- расчётный_блок_3.python (19 lines) ----------
def transform_parameter(parameter):
	if '.' in parameter:
		return float(parameter)
	return int(parameter)


dimension_corner_dict = {'2': {'3': 0.89, '4': 1.15}, '2.5': {'3': 1.12, '4': 1.46}, '2.8': {'3': 1.27}, '3': {'3': 1.36, '4': 1.78}, '3.2': {'3': 1.46, '4': 1.91}, '3.5': {'3': 1.6, '4': 2.1, '5': 2.58}, '4': {'3': 1.85, '4': 2.42, '5': 2.98}, '4.5': {'3': 2.08, '4': 2.73, '5': 3.37}, '5': {'3': 2.32, '4': 3.05, '5': 3.77, '6': 4.47}, '5.6': {'4': 3.44, '5': 4.25}, '6.3': {'4': 3.9, '5': 4.81, '6': 5.72}, '7': {'4.5': 4.87, '5': 5.38, '6': 6.39, '7': 7.39, '8': 8.37}, '7.5': {'5': 5.8, '6': 6.89, '7': 7.96, '8': 9.02, '9': 10.07}, '8': {'5.5': 6.78, '6': 7.36, '7': 8.51, '8': 9.65}, '9': {'6': 8.33, '7': 9.64, '8': 10.93, '9': 12.2}, '10': {'6.5': 10.06, '7': 10.79, '8': 12.25, '10': 15.1, '12': 17.9, '14': 20.63, '16': 23.3}, '11': {'7': 11.89, '8': 13.5}, '12.5': {'8': 15.46, '9': 17.3, '10': 19.1, '12': 22.68, '14': 26.2, '16': 29.65}, '14': {'9': 19.41, '10': 21.45, '12': 25.5}, '16': {'10': 24.67, '11': 27.02, '12': 29.35, '14': 34.2, '16': 38.52, '18': 43.01, '20': 47.41}, '18': {'11': 30.47, '12': 33.12}, '20': {'12': 36.97, '13': 39.92, '14': 42.8, '16': 48.65, '20': 60.08, '25': 74.02, '30': 87.56}, '22': {'14': 47.4, '16': 53.83}, '25': {'16': 61.55, '18': 68.86, '20': 76.11, '22': 83.31, '25': 93.97, '28': 104.5, '30': 111.44, '35': 128.51}}
if IN[0][:3] == 'Код':
	OUT = IN[0]
else:
	dimension_list, count_list = IN[0][:len(IN[0]) // 2][0], IN[0][len(IN[0]) // 2 : len(IN[0])][0]
	total = 0.0
	lst = []
	for i in range(len(dimension_list)):
		first_parameter, second_parameter = dimension_list[i].split('-')
		weight = dimension_corner_dict[first_parameter][second_parameter]
		first_parameter, second_parameter = transform_parameter(first_parameter), transform_parameter(second_parameter)	
		total += (first_parameter / 25.0 + 2 * (2 * first_parameter * second_parameter - second_parameter**2) / 10.0**6) * count_list[i] / weight
	OUT = total
# ----------------------------------------
расчётный_блок_4 = Python(IN[0]=модуль_проверки_вводимых_данных_4)
# ---------- расчётный_блок_4.python (9 lines) ----------
if IN[0][:3] == 'Код':
	OUT = IN[0]
else:
	dimension_list, count_list = IN[0][:len(IN[0]) // 2][0], IN[0][len(IN[0]) // 2 : len(IN[0])][0]
	total = 0.0
	for i in range(len(dimension_list)):
		b, a = map(int, dimension_list[i].split('-'))
		total += ((a + b) / 500.0 + 2 * a * b / 10.0**6) * count_list[i]
	OUT = total
# ----------------------------------------

# group: Итог работы скрипта
результирующий_блок_анализа_и = Python(IN[0]=расчётный_блок, IN[1]=расчётный_блок_2, IN[2]=расчётный_блок_3, IN[3]=расчётный_блок_4)  # "Результирующий блок анализа и обработки данных"; graph output
# ---------- результирующий_блок_анализа_и.python (55 lines) ----------
from math import ceil

error_dict = {
	'Код 011': 'В поле для ввода диаметров труб есть неуникальные позиции.\nУдалите дубликаты!', 
	'Код 012': 'В поле для ввода диаметров труб был внесён несуществующий в рамках ГОСТ 3262-75 размер трубы.\nУкажите только существующие диаметры труб!', 
	'Код 013': 'Одно или два поля для труб являются пустыми.\nНеобходимо заполнить данные поля данными, либо переключить кнопку у труб в положение False, чтобы не учитывать трубы в расчётах!',
	'Код 014': 'Количество диаметров труб и соответствующих им метражей не совпадает.\nУдалите лишние позиции, либо добавьте те, которых не хватает для расчёта!',
	'Код 021': 'В поле для ввода номеров швеллеров есть неуникальные позиции.\nУдалите дубликаты!', 
	'Код 022': 'В поле для ввода номеров швеллеров был внесён несуществующий в рамках ГОСТ 8240-97 номер швеллера.\nУкажите только существующие номера швеллеров!', 
	'Код 023': 'Одно или два поля для швеллеров являются пустыми.\nНеобходимо заполнить данные поля данными, либо переключить кнопку у швеллеров в положение False, чтобы не учитывать швеллерры в расчётах!',
	'Код 024': 'Количество номеров швеллеров и соответствующих им килограмм не совпадает.\nУдалите лишние позиции, либо добавьте те, которых не хватает для расчёта!',
	'Код 031': 'В поле для ввода номеров уголков и их толщин есть неуникальные позиции.\nУдалите дубликаты!', 
	'Код 032': 'В поле для ввода номеров уголков и их толщин был внесён несуществующий в рамках ГОСТ 8509-93 номер уголка и(или) его толщины.\nУкажите только существующие номера уголков и их толщины!', 
	'Код 033': 'Одно или два поля для уголков являются пустыми.\nНеобходимо заполнить данные поля данными, либо переключить кнопку у уголков в положение False, чтобы не учитывать уголки в расчётах!',
	'Код 034': 'Количество номеров уголков и их толщин и соответствующих им килограмм не совпадает.\nУдалите лишние позиции, либо добавьте те, которых не хватает для расчёта!',
	'Код 035': 'Ошибка в разделителе данных у уголков!\nНеобходимо разделить вводимые данные у уголков в формате: "Номер уголка-Толщина уголка" без пробелов или каких-либо других знаков препинания!',
	'Код 041': 'В поле для ввода ширины и толщины полосы есть неуникальные позиции.\nУдалите дубликаты!', 
	'Код 042': 'В поле для ввода ширины и толщины полосы был внесён несуществующий в рамках ГОСТ 103-2006 размер ширины и толщины полосы.\nУкажите только существующие размеры полосы!', 
	'Код 043': 'Одно или два поля для полосы являются пустыми.\nНеобходимо заполнить данные поля данными, либо переключить кнопку у полосы в положение False, чтобы не учитывать полосы в расчётах!',
	'Код 044': 'Количество размеров полосы и соответствующих им метражей не совпадает.\nУдалите лишние позиции, либо добавьте те, которых не хватает для расчёта!',
	'Код 045': 'Ошибка в разделителе данных у полосы!\nНеобходимо разделить вводимые данные у полосы в формате: "Ширина полосы-Толщина полосы" без пробелов или каких-либо других знаков препинания!'
}

warning_dict = {
	'Код 01404': 'Трубы по ГОСТ 3262-75',
	'Код 02404': 'Швеллеры по ГОСТ 8240-97',
	'Код 03404': 'Уголки по ГОСТ 8509-93',
	'Код 04404': 'Полосы по ГОСТ 103-2006'
}

error_list, warning_list = ['В результате расчёта были выявлены следующие ошибки:'], ['В результате расчёта некоторые элементы были не учтены:']
total_value_list = []
for now in IN:
	if now in error_dict:
		error_list.append(error_dict[now])
	elif now in warning_dict:
		warning_list.append(warning_dict[now])
	else:
		total_value_list.append(now)
if len(error_list) > 1:
	error_list.append('Исправьте указанные выше ошибки и запустите расчёт заново!')
	OUT = [1, 0.0, '\n'.join(error_list)]
elif len(warning_list) > 1 and not total_value_list:
	warning_list = ['В результате расчёта ни одни элементы не были учтены!']
	warning_list.append('Если Вы хотите их учесть в расчёте, то установите галочку в положение True у нужного элемента!\n')
	OUT = [2, 0.0, '\n'.join(warning_list)]
else:
	total_value_area = ceil(sum(total_value_list) * 100) / 100.0
	total_value_dye = ceil(total_value_area * 32) / 100.0
	result = 'По результатам расчёта были получены следующие данные:\nПлощадь окрашиваемой поверхности составляет ' + str(total_value_area) + ' квадратных метров.\n\nЗакупаемые материалы:\nГрунт-эмаль Masscoat155 (покрасить в 2 слоя): ' + str(total_value_dye) + ' килограмм.\nОбезжириватель Уайт-спирит (покрасить в 1 слой): ' + str(total_value_dye) + ' килограмм.\n\n'
	if len(warning_list) > 1:
		warning_list.append('Если Вы хотите их учесть в расчёте, то установите галочку в положение True у нужного элемента!\n')
		OUT = [3, total_value_dye, result + '\n'.join(warning_list)]
	else:
		OUT = [4, total_value_dye, result]
# ----------------------------------------
поставьте_галочку_в_положение = BoolSelector(false)  # "Поставьте галочку в положение True, если хотите занести полученные результаты в значения количества для грунт-эмали Masscoat 155 и Уайт-спирита (не забудьте установить К.запаса = 1 для краски и обезжиривателя!)"; graph input
итоговый_анализатор_с_занесением = Python(IN[0]=результирующий_блок_анализа_и, IN[1]=поставьте_галочку_в_положение)  # "Итоговый анализатор с занесением данных в параметры количества (RevitAPI)"
# ---------- итоговый_анализатор_с_занесением.python (44 lines) ----------
calculation_solution = IN[1]
code_analysis, total_value_dye, data_output = IN[0]
if calculation_solution and code_analysis in (3, 4):
	import clr
	
	clr.AddReference('RevitAPI')
	from Autodesk.Revit.DB import *
	
	clr.AddReference('RevitServices')
	from RevitServices.Persistence import DocumentManager as DM
	from RevitServices.Transactions import TransactionManager as TM
	
	import System
	from System import Guid
	from System.Collections.Generic import List
	
	doc = DM.Instance.CurrentDBDocument
	
	cats = List[BuiltInCategory]()
	cats.Add(BuiltInCategory.OST_DetailComponents)
	
	filter = ElementMulticategoryFilter(cats)
	
	elems = FilteredElementCollector(doc, doc.ActiveView.Id).WherePasses(filter).ToElements()
	
	vals, id_vals = [], ('194970', '41656')
	
	for el in elems:
		if el.get_Parameter(Guid('6c4a27c3-b1f2-4052-b343-d8d1a62023c0')).AsString() in id_vals and el.GetParameters('К.запаса')[0].AsDouble():
			vals.append(el)
	OUT = elems, vals
	TM.Instance.EnsureInTransaction(doc)
	
	for v in vals:
		v.get_Parameter(Guid('c6b2777b-70e5-42ca-8cba-3796bb2197fc')).Set(total_value_dye)
	
	TM.Instance.TransactionTaskDone()
	
	if vals:
		OUT = data_output + '\nЗначения для количества килограмм грунт-эмали Masscoat155 и Уайт-спирита были успешно занесены в соответствующие позиции чертёжного вида!'
	else:
		OUT = data_output + '\nЗначения для количества килограмм грунт-эмали Masscoat155 и Уайт-спирита не были занесены в чертёжный вид! Возможные решения проблемы:\n1. Уточните, точно ли существуют грунт-эмаль с номером_ЭК = 194970 и Уайт-спирит с номером_ЭК = 41656.\n2. Проверьте, установлены ли коэффициенты запаса (К.запаса) равными 1 для краски и обезжиривателя.'
else:
	OUT = data_output
# ----------------------------------------
подведение_итогов_работы = Watch(итоговый_анализатор_с_занесением)  # graph output
